% Simulink data dictionary Common.sldd

float32_T = Simulink.AliasType(BaseType="single")
Temp_degC = Simulink.Signal(DataType="float32_T")
Icur_mA = Simulink.Signal(DataType="float32_T")
CapFade_abs = Simulink.Signal(DataType="float32_T")
ImpGrow_abs = Simulink.Signal(DataType="float32_T")
Vp_mV = Simulink.Signal(DataType="float32_T")
soh = Simulink.Signal(DataType="float32_T")

voltage = Simulink.Bus()
  a: float32_T
  b: float32_T

soc_perc = Simulink.Signal(DataType="float32_T")
Rp_mohm = Simulink.Signal(DataType="float32_T")
Vlt_mV = Simulink.Signal(DataType="Bus: voltage")
schedule_flag = Simulink.Signal(DataType="float32_T")
Common_config_codegen = Simulink.ConfigSet(StartTime="0", StopTime="10", FixedStep="0.001", Solver="FixedStepDiscrete", ProdHWDeviceType="Intel->x86-64 (Windows64)", SystemTargetFile="ert.tlc", TargetLang="C")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